# Grasshopper definition grid_json_logic.ghx (Grasshopper 1.0.8)
# plug-ins: LunchBox, SelectablePreview, ShapeDiverForGrasshopper

sddp = ShapeDiverDocumentPayload({AbsoluteTolerance=0, AngleTolerance=0, DistanceDisplayPrecision=0, GltfVersion="Gltf2", GrasshopperVersion="1.0.0008", InputGroups="{}", OutputGroups="{}", RelativeTolerance=0, RhinoVersion="8.17.25066.7001", UnitSystem=0, VersionCreated="1.24.1.0", VersionSaved="1.25.0.0"})

# ---- group: Grid Definition
pt = Point(Point(-5140.482067, 30747.04282, 0))
pl = ConstructPlane(Origin=pt, XAxis=Vector(1, 0, 0), YAxis=Vector(0, 1, 0))
width = Slider(3500, range=3500..4500)
grid_size_x = Slider(10, range=0..10)
length = Slider(3500, range=3500..4500)
grid_size_y = Slider(10, range=0..10)
prot = RotatePlane(Plane=pl, Angle=degrees(Slider(0, range=0..360)))
recgrid = Rectangular(Plane=prot, SizeX=width, SizeY=length, ExtentX=grid_size_x, ExtentY=grid_size_y)  # -> simplify(Cells), Points
deplane = DeconstructPlane(Plane=prot)  # -> Origin, XAxis, YAxis, ZAxis

# ---- group: Grid Tag
tstat = TreeStatistics(Tree=recgrid.Cells)  # -> Paths, Length, Count
series = Series(Start=0, Step=1, Count=tstat.Count)  # -> graft(Series)
area = Area(Geometry=recgrid.Cells)  # -> Area, Centroid
series_2 = Series(Start=0, Step=1, Count=tstat.Count)
crossref = CrossReference(ListA=series, ListB=series_2, CrossMode=1)  # -> ListA, simplify(ListB)
format = Format(Format="{0},{1}", Culture=127, Data0=crossref.ListA, Data1=crossref.ListB)  # -> simplify(Text)
tag = TextTag(Location=area.Centroid, Text=format)

# ---- group: Grid Selection
boundary = BoundarySurfaces(Edges=recgrid.Cells)
flatten = FlattenTree(Tree=boundary, Path="{0}")
preview = CustomPreview(Geometry=boundary, Material=ColourSwatch(SwatchColor=RGBA(93, 255, 255, 142)))

# ---- group: Grid Selection / Cells Selection
selpv = SelectablePreview(Geometry=boundary, lock=True, maintain=False, order=False, selectedobject="53|63|73|76|75|74|36|35|34|24|23|33|32|22")  # -> Geometry, Path, Index

# ---- group: Cells Segments
explode = Explode(Curve=recgrid.Cells, Recursive=True)  # -> simplify(Segments), Vertices

tstat_2 = TreeStatistics(Tree=explode.Segments)  # -> Paths, Length, Count
panel = Panel(tstat_2.Paths)

len = Length(Curve=explode.Segments)
segments_length = Panel(len)

# ---- group: Occupied_Cells
fragment = TextFragment(Text=selpv.Path, Start="1", Count="1")
format_2 = Format(Format="{0};{1}", Culture=127, Data0=fragment, Data1=selpv.Index)
concat = Concatenate(FragmentA="{", FragmentB=format_2)
concat_2 = Concatenate(FragmentA=concat, FragmentB="}")
panel_2 = Panel(tstat_2.Paths)
panel_3 = Panel(concat_2)

# ----
list_mask = Python3Script(check_list=panel_3, full_list=panel_2)  # -> out, result; inputs check_list: list, full_list: list
# ---------- list_mask: Python ----------
# Convert check list to a set for fast lookup
check_set = set(map(tuple,check_list))

# Return True for each pair in full_list if it's in the check_set
result = [tuple(item) in check_set for item in full_list]
# ---------- end list_mask ----------
not = GateNot(A=list_mask.result)

cull = CullPattern(List=flatten, CullPattern=list_mask.result)
cull_2 = CullPattern(List=panel, CullPattern=list_mask.result)
selected = Panel(cull_2)
objs_to_pths = ObjectsToPaths(objects=cull, paths=cull_2)  # -> out, tree; inputs objects: list, paths: list
# ---------- objs_to_pths: Python ----------
from Grasshopper import DataTree
from Grasshopper.Kernel.Data import GH_Path

# Use object tree to store geometry (not converted to string!)
tree = DataTree[object]()

def parse_path_string(s):
    return tuple(map(int, s.strip('{}').split(';')))

for i, val in enumerate(objects):
    try:
        path_tuple = parse_path_string(paths[i])
        path = GH_Path(*path_tuple)

        # Add geometry (Surface, Brep, etc.) directly
        tree.Add(val, path)

    except Exception as e:
        print(f"Error at index {i}: {e}")
# ---------- end objs_to_pths ----------

cull_3 = CullPattern(List=flatten, CullPattern=not)
cull_4 = CullPattern(List=panel, CullPattern=not)
not_selected = Panel(cull_4)
objects_to_paths = Python3Script(objects=cull_3, paths=cull_4)  # -> out, tree; inputs objects: list, paths: list; same code as objs_to_pths

# ---- group: Preview not selected
preview_2 = CustomPreview(Geometry=objects_to_paths.tree, Material=ColourSwatch(SwatchColor=RGB(57, 242, 255)))

# ----
tstat_3 = TreeStatistics(Tree=objs_to_pths.tree)  # -> Paths, Length, Count

# ---- group: Preview Selected
preview_3 = CustomPreview(
    Geometry=objs_to_pths.tree,
    Material={diffuse=RGB(221, 160, 221), emission=RGB(66, 48, 66), shine=0.5, specular=RGB(255, 255, 255), transparency=0})

# ---- group: Cell Selection
item = ListItem(List=tstat_3.Paths, Index=Slider(0, range=0..8), Wrap=True)

# ---- group: Cells Edges Tag
branch = TreeBranch(Tree=objs_to_pths.tree, Path=item, MaintainPaths=True)
explode_2 = Explode(Curve=branch, Recursive=True)  # -> Segments, Vertices
shift = ShiftList(List=explode_2.Segments, Shift=1, Wrap=True)
lng = ListLength(List=shift)
series_3 = Series(Start=0, Step=1, Count=lng)
midpt = CurveMiddle(Curve=shift)
tag_2 = TextTag(Location=midpt, Text=series_3, Colour=ColourSwatch(SwatchColor=RGB(21, 0, 255)))

# ---- group: Cell Selection
panel_4 = Panel("0")
panel_5 = Panel("1")

# ----
item_2 = ListItem(List=shift, Index=panel_4, Wrap=True)
item_3 = ListItem(List=shift, Index=panel_5, Wrap=True)

# ---- group: Panels Y Direction
len_2 = Length(Curve=item_3)
addition = Addition(A=len_2, B="500")
series_4 = Series(Start=0, Step=addition, Count=Slider(5, range=0..10))
X = UnitX(Factor=series_4)
pt_2 = Point(Point(3332.385388, 11850.80118, 0))
move = Move(Geometry=pt_2, Motion=X)  # -> Geometry, Transform
rectangle = Rectangle(Plane=move.Geometry, XSize=len_2, YSize="3000", Radius=0)  # -> Rectangle, Length

# ---- group: Panels X Direction
len_3 = Length(Curve=item_2)
addition_2 = Addition(A=len_3, B="500")
series_5 = Series(Start=0, Step=addition_2, Count=Slider(5, range=0..10))
X_2 = UnitX(Factor=series_5)
pt_3 = Point(Point(3332.385388, 15685.55438, 0))
move_2 = Move(Geometry=pt_3, Motion=X_2)  # -> Geometry, Transform
rectangle_2 = Rectangle(Plane=move_2.Geometry, XSize=len_3, YSize="3000", Radius=0)  # -> Rectangle, Length

# ----
boundary_2 = BoundarySurfaces(Edges=rectangle.Rectangle)
hash = HashObjects(Object=boundary_2, Encryption="SHA256")

# ---- group: Panel Selection Y / Panel_Selection_Y
number_slider = Slider(0, range=0..4)

# ---- group: Panel Selection Y
pframe = PerpFrame(Curve=reparameterize(item_3), Parameter="0.5")
end = EndPoints(Curve=item_3)  # -> Start, End
deplane_2 = DeconstructPlane(Plane=pframe)  # -> Origin, XAxis, YAxis, ZAxis
vec2pt = Vector2Pt(PointA=end.Start, PointB=end.End, Unitize=False)  # -> Vector, Length
boundary_3 = BoundarySurfaces(Edges=rectangle.Rectangle)
item_4 = ListItem(List=boundary_3, Index=number_slider, Wrap=True)
pl_2 = ConstructPlane(Origin=deplane_2.Origin, XAxis=deplane_2.XAxis, YAxis=vec2pt.Vector)
preview_4 = CustomPreview(Geometry=item_4, Material=ColourSwatch(SwatchColor=RGB(185, 2, 255)))
explode_3 = Explode(Curve=item_4, Recursive=True)  # -> Segments, Vertices
shift_2 = ShiftList(List=explode_3.Segments, Shift=1, Wrap=True)
item_5 = ListItem(List=shift_2, Index=0, Wrap=True)
neg = Negative(Value=Slider(90, range=0..1000))
prot_2 = RotatePlane(Plane=pl_2, Angle=degrees(neg))
midpt_2 = CurveMiddle(Curve=item_5)

# ----
lng_2 = ListLength(List=hash)
series_6 = Series(Start=0, Step=1, Count=lng_2)
int = Integer(series_6)
int_2 = Integer(number_slider)
py3 = Python3Script(keys=int, values=hash)  # -> out, dictionary; inputs keys: list, values: list
# ---------- py3: Python ----------
if keys and values:
    dictionary = [dict(zip(keys, values))]
    print(dictionary)
else:
    pass
# ---------- end py3 ----------
py3_2 = Python3Script(dictionary=py3.dictionary, keys_to_get=int_2)  # -> out, values; inputs keys_to_get: list
# ---------- py3_2: Python ----------
if dictionary and keys_to_get:
    values = [dictionary[k] for k in keys_to_get]
else:
    pass
# ---------- end py3_2 ----------
panel_6 = Panel(py3.out)
panel_7 = Panel(py3.dictionary)
trim = TrimTree(Tree=py3_2.values, Depth=Slider(5, range=0..10))
panel_hash = Panel(trim)

boundary_4 = BoundarySurfaces(Edges=rectangle_2.Rectangle)
hash_2 = HashObjects(Object=boundary_4, Encryption="SHA256")

explode_4 = Explode(Curve=rectangle.Rectangle, Recursive=True)  # -> Segments, Vertices
item_6 = ListItem(List=explode_4.Segments, Index=0, Wrap=True)

lng_3 = ListLength(List=hash_2)
series_7 = Series(Start=0, Step=1, Count=lng_3)
int_3 = Integer(series_7)
py3_3 = Python3Script(keys=int_3, values=hash_2)  # -> out, dictionary; inputs keys: list, values: list; same code as py3

# ---- group: Generic Door
door_size = Slider(900, range=600..1200)
door_height = Panel("2100")
rectangle_3 = Rectangle(Plane=PlaneXY(0, 0, 0), XSize=door_size, YSize=door_height, Radius=0)  # -> Rectangle, Length

# ----
offset_door = Panel("300")
len_4 = Length(Curve=item_6)
subtraction = Subtraction(A=len_4, B=offset_door)
dom = ConstructDomain(DomainStart=offset_door, DomainEnd=subtraction)
subcrv = SubCurve(BaseCurve=item_6, Domain=dom)  # -> flatten(Curve)

panel_8 = Panel(py3_3.out)

# ---- group: Panels with Door Y
panel_9 = Panel("""1
4""")
item_7 = ListItem(List=subcrv, Index=panel_9, Wrap=True)

# ---- group: Panel Selection Y / Oriented Panel Y
orient = Orient(Geometry=item_4, Source=midpt_2, Target=prot_2)  # -> Geometry, Transform

# ---- group: Doors Placement / Second Door
number_slider_2 = Slider(0.1, range=0..1)

# ---- group: Doors Placement / First Door
number_slider_3 = Slider(0, range=0..1)

# ----
item_8 = ListItem(List=shift, Index=Slider(0, range=0..3), Wrap=True)
pframe_2 = PerpFrame(Curve=reparameterize(item_8), Parameter="0.5")
end_2 = EndPoints(Curve=item_8)  # -> Start, End
deplane_3 = DeconstructPlane(Plane=pframe_2)  # -> Origin, XAxis, YAxis, ZAxis
vec2pt_2 = Vector2Pt(PointA=end_2.Start, PointB=end_2.End, Unitize=False)  # -> Vector, Length
neg_2 = Negative(Value=vec2pt_2.Vector)
pl_3 = ConstructPlane(Origin=deplane_3.Origin, XAxis=deplane_3.XAxis, YAxis=neg_2)
neg_3 = Negative(Value=Slider(90, range=0..1000))
prot_3 = RotatePlane(Plane=pl_3, Angle=degrees(neg_3))

# ---- group: Panel Selection X / panel_selection_X
number_slider_4 = Slider(0, range=0..4)

# ---- group: Panel Type Y Json
dup = DuplicateData(Data=length, Number=lng_3, Order=True)
panel_length = Panel(dup)
panel_hash_2 = Panel(hash)
panel_type_x = Panel(int)
merge = Merge(Data1="Panel Type Y", Data2="Panel Hash", Data3="Panel Length")
entwine = Entwine(Branch00=panel_type_x, Branch01=panel_hash_2, Branch02=panel_length, FlattenInputs=True)
datatable = CreateDataTable(TableName="Panel Types Y", TableHeaders=merge, ValueTree=entwine)

# ---- group: Panel Type X Json
panel_hash_3 = Panel(hash_2)
dup_2 = DuplicateData(Data=width, Number=lng_3, Order=True)
panel_length_2 = Panel(dup_2)
panel_type_x_2 = Panel(int_3)
merge_2 = Merge(Data1="Panel Type X", Data2="Panel Hash", Data3="Panel Length")
entwine_2 = Entwine(Branch00=panel_type_x_2, Branch01=panel_hash_3, Branch02=panel_length_2, FlattenInputs=True)
datatable_2 = CreateDataTable(TableName="Panel Types X", TableHeaders=merge_2, ValueTree=entwine_2)
panel_10 = Panel(merge_2)
merge_3 = Merge(Data1=datatable_2, Data2=datatable)
dataset = CreateDataSet(DataSetName="Panel Types", DataTables=merge_3)

# ---- group: Save to File Json
toggle = BooleanToggle(False)

# ---- group: Dataset Creation
x_axis = Panel(deplane.XAxis)
grid_size_y_2 = Panel(grid_size_y)
y_axis = Panel(deplane.YAxis)
plane_origin = Panel(deplane.Origin)
grid_size_x_2 = Panel(grid_size_x)
series_8 = Series(Start=0, Step=1, Count=Slider(4, range=0..10))
pack_list = Python3Script(list_in=selected)  # -> out, packed_list; inputs list_in: list
# ---------- pack_list: Python ----------
packed_list = repr(list_in)
# ---------- end pack_list ----------
pack_list_2 = Python3Script(list_in=not_selected)  # -> out, packed_list; inputs list_in: list; same code as pack_list
hash_3 = HashObjects(Object=objs_to_pths.tree, Encryption="SHA256")
hash_4 = HashObjects(Object=pt, Encryption="SHA256")
merge_4 = Merge(Data1="Cell", Data2="Cell Hash", Data3=series_8)  # -> flatten(Result)
flatten_2 = FlattenTree(Tree=hash_3, Path="{0}")
panel_11 = Panel("""Hash
Plane Origin
X_axis
Y_axis
Grid_Size_X
Grid_Size_Y
Selected_Cells
Diselected_Cells""")
entwine_3 = Entwine(Branch00=selected, Branch01=flatten_2, FlattenInputs=True)  # -> simplify(Result)
panel_12 = Panel(pack_list.packed_list)
panel_13 = Panel(pack_list_2.packed_list)
datatable_3 = CreateDataTable(TableName="Cells", TableHeaders=merge_4, ValueTree=entwine_3)
entwine_4 = Entwine(
    Branch00=hash_4,
    Branch01=plane_origin,
    Branch02=x_axis,
    Branch03=y_axis,
    Branch04=grid_size_x_2,
    Branch05=grid_size_y_2,
    Branch06=pack_list.packed_list,
    Branch07=pack_list_2.packed_list,
    FlattenInputs=True)  # -> simplify(Result)
datatable_4 = CreateDataTable(TableName="Grids", TableHeaders="Grid_hash", ValueTree=hash_4)
datatable_5 = CreateDataTable(TableName="Grid", TableHeaders=panel_11, ValueTree=entwine_4)
merge_5 = Merge(Data1=datatable_4, Data2=datatable_5, Data3=datatable_3)
dataset_2 = CreateDataSet(DataSetName="Export_Json", DataTables=merge_5)
json = CreateJSON(WriteJSON=toggle, DataSet=dataset_2)

# ----
json_2 = CreateJSON(WriteJSON=False, DataSet=dataset)

# ---- group: Generic Door
explode_5 = Explode(Curve=rectangle_2.Rectangle, Recursive=True)  # -> Segments, Vertices
item_9 = ListItem(List=explode_5.Segments, Index=0, Wrap=True)  # -> simplify(Item)

offset_door_2 = Panel("300")
len_5 = Length(Curve=item_9)

addition_3 = Addition(A=offset_door_2, B=door_size)

subtraction_2 = Subtraction(A=len_5, B=addition_3)
dom_2 = ConstructDomain(DomainStart=offset_door_2, DomainEnd=subtraction_2)
subcrv_2 = SubCurve(BaseCurve=item_9, Domain=dom_2)  # -> flatten(Curve)

# ---- group: Panels with Door X
panel_14 = Panel("0")
panel_15 = Panel("3")
item_10 = ListItem(List=subcrv_2, Index=panel_14, Wrap=True)
item_11 = ListItem(List=rectangle_2.Rectangle, Index=panel_14, Wrap=True)
item_12 = ListItem(List=subcrv_2, Index=panel_15, Wrap=True)

# ----
item_13 = ListItem(List=rectangle_2.Rectangle, Index=panel_15, Wrap=True)
panel_16 = Panel("""0
3""")
panel_17 = Panel("""1
2""")
explode_6 = Explode(Curve=item_13, Recursive=True)  # -> Segments, Vertices
item_14 = ListItem(List=explode_6.Segments, Index=panel_16, Wrap=True)
item_15 = ListItem(List=explode_6.Segments, Index=panel_17, Wrap=True)

# ---- group: Doors Placement
eval = EvaluateCurve(Curve=reparameterize(item_10), Parameter=number_slider_3)  # -> Point, Tangent, Angle
eval_2 = EvaluateCurve(Curve=reparameterize(item_12), Parameter=number_slider_2)  # -> Point, Tangent, Angle
orient_2 = Orient(Geometry=rectangle_3.Rectangle, Source=PlaneXY(0, 0, 0), Target=eval_2.Point)  # -> Geometry, Transform
orient_3 = Orient(Geometry=rectangle_3.Rectangle, Source=PlaneXY(0, 0, 0), Target=eval.Point)  # -> Geometry, Transform

# ---- group: Door Hash
crv = Curve(orient_3.Geometry)
hash_5 = HashObjects(Object=crv, Encryption="SHA256")

# ----
crv_2 = Curve(orient_2.Geometry)
hash_6 = HashObjects(Object=crv_2, Encryption="SHA256")

# ---- group: Window Constrain
number_slider_5 = Slider(1056, range=900..1200)
offset_window = Panel("300")
offset_window_2 = Panel("300")
offset = OffsetCurve(Curve=item_14, Distance=expr("-x", offset_window_2), Corners=1)
addition_4 = Addition(A=number_slider_5, B=offset_window)
offset_2 = OffsetCurve(Curve=item_15, Distance=expr("-x", addition_4), Corners=1)
merge_6 = Merge(Data1=offset, Data2=offset_2)  # -> flatten(Result)
mcx = MultipleCurves(Curves=merge_6)  # -> Points, IndexA, IndexB, ParamA, ParamB
alongcrv = SortAlongCurve(Points=mcx.Points, Curve=item_13)  # -> Points, Indices
pline = PolyLine(Vertices=alongcrv.Points, Closed=True)

# ---- group: Window Creation
md_slider = MDSlider(
    SliderMode=0,
    slider_value=Point(0.9132622613, 0.6784439087, 0.5),
    x_domain=Domain(0, 1),
    y_domain=Domain(0, 1),
    z_domain=Domain(0, 1))
boundary_5 = BoundarySurfaces(Edges=pline)
number_slider_6 = Slider(905, range=900..1200)
evalsrf = EvaluateSurface(Surface=reparameterize(boundary_5), Point=md_slider)  # -> Point, Normal, UDirection, VDirection, Frame
rectangle_4 = Rectangle(Plane=evalsrf.Point, XSize=number_slider_5, YSize=number_slider_6, Radius=0)  # -> Rectangle, Length

# ----
merge_7 = Merge(Data1=panel_14, Data2=panel_15)
cull_i = CullIndex(List=rectangle_2.Rectangle, Indices=merge_7, Wrap=True)
rdiff = RegionDifference(CurvesA=item_11, CurvesB=orient_3.Geometry)
boundary_6 = BoundarySurfaces(Edges=cull_i)
merge_8 = Merge(Data1=orient_2.Geometry, Data2=rectangle_4.Rectangle)
boundary_7 = BoundarySurfaces(Edges=rdiff)
rdiff_2 = RegionDifference(CurvesA=item_13, CurvesB=flatten(merge_8))
boundary_8 = BoundarySurfaces(Edges=rdiff_2)
merge_9 = Merge(Data1=boundary_6, Data2=boundary_7, Data3=boundary_8)
area_2 = Area(Geometry=merge_9)  # -> Area, Centroid
pdecon = Deconstruct(Point=area_2.Centroid)  # -> XComponent, YComponent, ZComponent
sort = SortList(Keys=pdecon.XComponent, ValuesA=merge_9)  # -> Keys, ValuesA, ValuesB

# ---- group: Clash Dection Window and Door
ccx = CurveCurve(CurveA=orient_2.Geometry, CurveB=rectangle_4.Rectangle)  # -> Points, ParamsA, ParamsB
lng_4 = ListLength(List=ccx.Points)
larger = LargerThan(FirstNumber=lng_4, SecondNumber=Slider(0, range=0..100))  # -> LargerThan, OrEqualTo
dispatch = Dispatch(List=rectangle_4.Rectangle, DispatchPattern=larger.LargerThan)  # -> ListA, ListB
boundary_9 = BoundarySurfaces(Edges=dispatch.ListA)
area_3 = Area(Geometry=boundary_9)  # -> Area, Centroid
preview_5 = CustomPreview(Geometry=boundary_9, Material=ColourSwatch(SwatchColor=RGB(255, 0, 0)))
tag_3 = TextTag(Location=area_3.Centroid, Text="Colliding")

# ---- group: Window Hash
crv_3 = Curve(rectangle_4.Rectangle)
hash_7 = HashObjects(Object=crv_3, Encryption="SHA256")

# ---- group: Windows and Doors Data
door_hash = Panel(hash_6)
door_origin = Panel(eval_2.Point)
door_height_2 = Panel(door_height)
door_width = Panel(door_size)

panel_type_x_3 = Panel(panel_15)
panel_hash_4 = Panel(panel_hash)

# ---- group: Panel Selection X
item_16 = ListItem(List=sort.ValuesA, Index=number_slider_4, Wrap=True)
preview_6 = CustomPreview(Geometry=item_16, Material=ColourSwatch(SwatchColor=RGB(185, 2, 255)))

# ---- group: Windows and Doors Data
window_height = Panel(number_slider_6)
window_origin = Panel(evalsrf.Point)
window_width = Panel(number_slider_5)
window_hash = Panel(hash_7)

# ---- group: Panel X Visualisation
item_17 = ListItem(List=rectangle_2.Rectangle, Index=number_slider_4, Wrap=True)
explode_7 = Explode(Curve=item_17, Recursive=True)  # -> Segments, Vertices
item_18 = ListItem(List=explode_7.Segments, Index=0, Wrap=True)
midpt_3 = CurveMiddle(Curve=item_18)
orient_4 = Orient(Geometry=item_16, Source=midpt_3, Target=prot_3)  # -> Geometry, Transform

# ---- group: Doors Json
door_height_3 = Panel(door_height)
door_hash_2 = Panel(hash_5)
door_width_2 = Panel(door_size)
door_origin_2 = Panel(eval.Point)

panel_18 = Panel("""0
3""")
entwine_5 = Entwine(Branch00=door_hash_2, Branch01=door_hash, FlattenInputs=True)  # -> simplify(Result)
entwine_6 = Entwine(Branch00=door_height_3, Branch01=door_height_2, FlattenInputs=True)  # -> simplify(Result)
entwine_7 = Entwine(Branch00=door_origin_2, Branch01=door_origin, FlattenInputs=True)  # -> simplify(Result)
entwine_8 = Entwine(Branch00=door_width_2, Branch01=door_width, FlattenInputs=True)  # -> simplify(Result)
merge_10 = Merge(Data1="Host Panel", Data2="Hash", Data3="Origin", Data4="Width", Data5="Height")
item_19 = ListItem(List=panel_hash_3, Index=panel_18, Wrap=True)  # -> simplify(graft(Item))
entwine_9 = Entwine(Branch00=item_19, Branch01=entwine_5, Branch02=entwine_7, Branch03=entwine_8, Branch04=entwine_6, FlattenInputs=True)
datatable_6 = CreateDataTable(TableName="Doors", TableHeaders=merge_10, ValueTree=entwine_9)
dataset_3 = CreateDataSet(DataSetName="Doors", DataTables=datatable_6)
json_3 = CreateJSON(WriteJSON=toggle, DataSet=dataset_3)

# ---- group: Windows Json
item_20 = ListItem(List=panel_hash_3, Index=Slider(3, range=0..10), Wrap=True)
merge_11 = Merge(Data1="Host Panel", Data2="Hash", Data3="Origin", Data4="Width", Data5="Height")
entwine_10 = Entwine(
    Branch00=item_20,
    Branch01=window_hash,
    Branch02=window_origin,
    Branch03=window_width,
    Branch04=window_height,
    FlattenInputs=True)  # -> simplify(Result)
datatable_7 = CreateDataTable(TableName="Windows", TableHeaders=merge_11, ValueTree=entwine_10)
dataset_4 = CreateDataSet(DataSetName="Windows", DataTables=datatable_7)
json_4 = CreateJSON(WriteJSON=toggle, DataSet=dataset_4)

# ---- group: Panels Database
py3_4 = Python3Script(x=json_2, y=json_3, z=json_4)  # -> out, a; inputs x: list, y: list, z: list
# ---------- py3_4: Python ----------
import json
from collections import defaultdict

# Step 1: Parse JSON strings from Grasshopper inputs
x_data = json.loads(x[0]) if isinstance(x, list) and isinstance(x[0], str) else {}
y_data = json.loads(y[0]) if isinstance(y, list) and isinstance(y[0], str) else {}
z_data = json.loads(z[0]) if isinstance(z, list) and isinstance(z[0], str) else {}

# Step 2: Extract panel types and components
panel_types_x = x_data.get("Panel Types X", [])
panel_types_y = x_data.get("Panel Types Y", [])
doors = y_data.get("Doors", [])
windows = z_data.get("Windows", [])

# Step 3: Map Host Panel → Doors and Windows
panel_to_doors = defaultdict(list)
panel_to_windows = defaultdict(list)

for door in doors:
    if isinstance(door, dict):
        host_panel = door.get("Host Panel", "").strip()
        panel_to_doors[host_panel].append(door)

for window in windows:
    if isinstance(window, dict):
        host_panel = window.get("Host Panel", "").strip()
        panel_to_windows[host_panel].append(window)

# Step 4: Inject doors and windows into Panel Types X
for panel in panel_types_x:
    if isinstance(panel, dict):
        panel_hash = panel.get("Panel Hash", "").strip()
        panel["Doors"] = panel_to_doors.get(panel_hash, [])
        panel["Windows"] = panel_to_windows.get(panel_hash, [])

# Step 5: Inject doors and windows into Panel Types Y
for panel in panel_types_y:
    if isinstance(panel, dict):
        panel_hash = panel.get("Panel Hash", "").strip()
        panel["Doors"] = panel_to_doors.get(panel_hash, [])
        panel["Windows"] = panel_to_windows.get(panel_hash, [])

# Step 6: Output the modified structure with same keys
output_data = {
    "Panel Types X": panel_types_x,
    "Panel Types Y": panel_types_y
}

# Step 7: Export to JSON string
a = json.dumps(output_data, indent=2)
# ---------- end py3_4 ----------
database = Panel(py3_4.a)

# ---- group: Dataset Assign Panels Types
merge_12 = Merge(Data1=number_slider_4, Data2=number_slider)
panel_types = Panel(merge_12)
merge_13 = Merge(Data1=panel_4, Data2=panel_5)
item_21 = ListItem(List=merge_12, Index=0, Wrap=True)  # -> Item, Item1, Item2
int_4 = Integer(item_21.Item1)
int_5 = Integer(item_21.Item)
cell_edges = Panel(merge_13)
py3_5 = Python3Script(x=database, p=int_4)  # -> out, a; inputs x: list
# ---------- py3_5: Python ----------
import json

# STEP 1: Normalize input (string or dict)
if isinstance(x, list) and len(x) > 0:
    if isinstance(x[0], str):
        try:
            x_data = json.loads(x[0])  # parse JSON string
        except Exception as e:
            a = f"Failed to parse JSON: {e}"
            x_data = {}
    elif isinstance(x[0], dict):
        x_data = x[0]
    else:
        x_data = {}
elif isinstance(x, dict):
    x_data = x
else:
    x_data = {}

# STEP 2: Extract Panel Types X
panels_x = x_data.get("Panel Types Y", [])
print("Looking for Panel Type Y:", p)
print("Total panels found:", len(panels_x))

# STEP 3: Search for match
result = None
for panel in panels_x:
    if isinstance(panel, dict):
        try:
            if int(panel.get("Panel Type Y")) == int(p):
                result = panel
                break
        except:
            continue

# STEP 4: Output
a = json.dumps(result, indent=2) if result else "Not found"
# ---------- end py3_5 ----------
py3_6 = Python3Script(x=database, p=int_5)  # -> out, a; inputs x: list
# ---------- py3_6: Python ----------
import json

# STEP 1: Normalize input (string or dict)
if isinstance(x, list) and len(x) > 0:
    if isinstance(x[0], str):
        try:
            x_data = json.loads(x[0])  # parse JSON string
        except Exception as e:
            a = f"Failed to parse JSON: {e}"
            x_data = {}
    elif isinstance(x[0], dict):
        x_data = x[0]
    else:
        x_data = {}
elif isinstance(x, dict):
    x_data = x
else:
    x_data = {}

# STEP 2: Extract Panel Types X
panels_x = x_data.get("Panel Types X", [])
print("Looking for Panel Type X:", p)
print("Total panels found:", len(panels_x))

# STEP 3: Search for match
result = None
for panel in panels_x:
    if isinstance(panel, dict):
        try:
            if int(panel.get("Panel Type X")) == int(p):
                result = panel
                break
        except:
            continue

# STEP 4: Output
a = json.dumps(result, indent=2) if result else "Not found"
# ---------- end py3_6 ----------
panel_19 = Panel(item)
merge_14 = Merge(Data1=py3_6.a, Data2=py3_5.a)
py3_7 = Python3Script(k=panel_19, v=merge_14, z=cell_edges)  # -> out, a
# ---------- py3_7: Python ----------
import json

# STEP 1: Normalize `k` (key string), `v` (panel data), `z` (edge info)

# --- Handle key `k`
if isinstance(k, list) and len(k) > 0:
    key_str = str(k[0])
elif isinstance(k, str):
    key_str = k
else:
    key_str = None

# --- Handle value `v` (panel object)
if isinstance(v, list) and len(v) > 0:
    if isinstance(v[0], dict):
        panel_data = v[0]
    elif isinstance(v[0], str):
        try:
            panel_data = json.loads(v[0])
        except:
            panel_data = None
elif isinstance(v, dict):
    panel_data = v
elif isinstance(v, str):
    try:
        panel_data = json.loads(v)
    except:
        panel_data = None
else:
    panel_data = None

# --- Handle z as Cell Edge
cell_edge = z[0] if isinstance(z, list) and len(z) > 0 else z

# STEP 2: Construct output dictionary
out = {}

if key_str and isinstance(panel_data, dict):
    panel_copy = dict(panel_data)  # Copy panel to avoid mutating original
    panel_copy["Cell Edge"] = cell_edge  # Add the new key
    out[key_str] = panel_copy
else:
    out["error"] = {
        "k": str(k),
        "v": str(v),
        "z": str(z),
        "key_str": str(key_str),
        "panel_data": str(panel_data),
        "cell_edge": str(cell_edge)
    }

# STEP 3: Output as JSON
a = json.dumps(out, indent=2)
# ---------- end py3_7 ----------
py3_8 = Python3Script(x=json)  # -> out, a; inputs x: list
# ---------- py3_8: Python ----------
import json

# Step 1: Parse input JSON string
if isinstance(x, list) and len(x) > 0 and isinstance(x[0], str):
    try:
        data = json.loads(x[0])
    except Exception as e:
        a = f"JSON parse error: {e}"
        data = {}
else:
    a = "Invalid input format"
    data = {}

# Step 2: Add one numbered key per cell (numbered consistently across all)
cells = data.get("Cells", [])
num_keys = len(cells)  # Use number of cells as the dynamic key count

for cell in cells:
    if isinstance(cell, dict):
        for i in range(num_keys):
            cell[str(i)] = None

# Step 3: Output updated structure as JSON string
a = json.dumps(data, indent=2)
# ---------- end py3_8 ----------
py3_9 = Python3Script(a=py3_7.a, b=py3_8.a)  # -> out, a; inputs a: list, b: list
# ---------- py3_9: Python ----------
import json

# STEP 1: Parse input a (list of { "{3;4}": { ..., "Cell Edge": "0" } })
parsed_a = []
if isinstance(a, list):
    for item in a:
        if isinstance(item, str):
            try:
                parsed_a.append(json.loads(item))
            except:
                pass
        elif isinstance(item, dict):
            parsed_a.append(item)

# STEP 2: Parse input b (main base structure with "Cells")
if isinstance(b, list) and isinstance(b[0], str):
    try:
        base = json.loads(b[0])
    except:
        base = {}
elif isinstance(b, list) and isinstance(b[0], dict):
    base = b[0]
elif isinstance(b, dict):
    base = b
else:
    base = {}

cells = base.get("Cells", [])

# STEP 3: Build merge map → {cell_id: list of dicts with Cell Edge}
merge_map = {}
for obj in parsed_a:
    for cell_key, data in obj.items():
        if isinstance(data, dict):
            edge = data.pop("Cell Edge", None)
            if edge is not None:
                if cell_key not in merge_map:
                    merge_map[cell_key] = []
                merge_map[cell_key].append((edge, data))

# STEP 4: Inject into matching Cells
for cell in cells:
    cell_id = cell.get("Cell")
    if cell_id in merge_map:
        for edge_key, data_obj in merge_map[cell_id]:
            cell[edge_key] = data_obj  # Insert under edge key

# STEP 5: Output result
a = json.dumps(base, indent=2)
# ---------- end py3_9 ----------

# ---- group: Final Json
json_logic = Panel(py3_9.a)
